# Grasshopper definition 160420_PEV_Sim_Data.gh (Grasshopper 0.9.76)
# plug-ins: SonicStringDup

# OD Demand Data - dense
panel = Panel("24")
number_slider = Slider(0.5, range=0.1..5)
number_slider_2 = Slider(1, range=0.1..5)
# OD Demand Data - sparse
number_slider_3 = Slider(15, range=0..100)
# Road Pt Data
panel_2 = Panel("start")
number_slider_4 = Slider(1000, range=1..10000)  # disabled
number_slider_5 = Slider(0, range=0..100)  # disabled

# ---- group: RD CRV ONE WAY
crv = Curve(reparameterize([<curve referenced from the Rhino model> x108]))

# ---- group: RD CRV TWO WAY
crv_2 = Curve()

# ----
number_slider_6 = Slider(1000, range=1..10000)  # disabled
multiplication = Multiplication(A="24", B="60")
number_slider_7 = Slider(0, range=0..100)  # disabled
multiplication_2 = Multiplication(A=panel, B="60")
txt = Text("two way")
txt_2 = Text("one way")
panel_3 = Panel(multiplication)
txt_3 = Text(panel_2)
txt_4 = Text("end")
panel_4 = Panel(multiplication_2)

# ---- group: STEP LENGTH
num = Number(number_slider_3)

# ----
len = Length(Curve=crv_2)
len_2 = Length(Curve=crv)
dom = ConstructDomain(DomainStart=0, DomainEnd=panel_3)
division = Division(A=len, B=num)
dom_2 = ConstructDomain(DomainStart=0, DomainEnd=panel_4)
division_2 = Division(A=len_2, B=num)
random = Random(Range=dom, Number=number_slider_4, Seed=number_slider_5)  # disabled
divlength = DivideLength(Curve=crv_2, Length=num)  # -> Points, Tangents, Parameters
lng = ListLength(List=crv)
lng_2 = ListLength(List=crv_2)
divlength_2 = DivideLength(Curve=crv, Length=num)  # -> Points, Tangents, Parameters
random_2 = Random(Range=dom_2, Number=number_slider_6, Seed=number_slider_7)  # disabled
divide = DivideCurve(Curve=crv_2, Count=division, Kinks=False)  # -> Points, Tangents, Parameters
divide_2 = DivideCurve(Curve=crv, Count=division_2, Kinks=False)  # -> Points, Tangents, Parameters
int = Integer(random)  # disabled
int_2 = Integer(random_2)  # disabled
range = Range(Domain=dom, Steps=panel_3)
repeat = RepeatData(Data=txt_3, Length=lng_2)  # -> graft(Data)
repeat_2 = RepeatData(Data=txt_3, Length=lng)  # -> graft(Data)
repeat_3 = RepeatData(Data=txt, Length=lng_2)  # -> graft(Data)
repeat_4 = RepeatData(Data=txt_4, Length=lng_2)  # -> graft(Data)
repeat_5 = RepeatData(Data=txt_2, Length=lng)  # -> graft(Data)
repeat_6 = RepeatData(Data=txt_4, Length=lng)  # -> graft(Data)
range_2 = Range(Domain=dom_2, Steps=panel_4)
pt = Point(divide_2.Points)
pt_2 = Point(divide.Points)
stringdup = StringDuplicates(String=int)  # -> R, i, P; disabled
stringdup_2 = StringDuplicates(String=int_2)  # -> R, i, P; disabled
shift = ShiftList(List=range, Shift=-1, Wrap=False)
shift_2 = ShiftList(List=range_2, Shift=-1, Wrap=False)
xz = XZPlane(Origin=Point(0, 0, 0))
pshift = ShiftPaths(Data=repeat_3, Offset=1)
pshift_2 = ShiftPaths(Data=repeat_4, Offset=1)
pshift_3 = ShiftPaths(Data=repeat_5, Offset=1)
pshift_4 = ShiftPaths(Data=repeat_6, Offset=1)
pshift_5 = ShiftPaths(Data=repeat, Offset=1)
pshift_6 = ShiftPaths(Data=repeat_2, Offset=1)
dom_3 = ConstructDomain(DomainStart=0, DomainEnd=expr("X-1", panel_4))
pshift_7 = ShiftPaths(Data=shift_2, Offset=-1)
int_3 = Integer(shift)
sort = SortList(Keys=stringdup.R)  # -> Keys, ValuesA; disabled
mirror = Mirror(Geometry=pt, Plane=xz)  # -> Geometry, Transform

# ---- group: all road pts
pt_3 = Point(flatten([mirror.Geometry, pt_2]))

pt_4 = Point(flatten([mirror.Geometry, pt_2]))

# ----
lng_3 = ListLength(List=pt_3)
lng_4 = ListLength(List=pt_4)
subtraction = Subtraction(A=lng_3, B=1)
subtraction_2 = Subtraction(A=lng_4, B=1)
dom_4 = ConstructDomain(DomainStart=0, DomainEnd=subtraction)
dom_5 = ConstructDomain(DomainStart=0, DomainEnd=subtraction_2)
pt_5 = Point(mirror.Geometry)
pdecon = Deconstruct(Point=pt_5)  # -> XComponent, YComponent, ZComponent
panel_5 = Panel(pdecon.XComponent)
sort_2 = SortList(Keys=stringdup_2.R)  # -> Keys, ValuesA; disabled
xz_2 = XZPlane(Origin=Point(0, 0, 0))
int_4 = Integer(pshift_7)
pshift_8 = ShiftPaths(Data=sort.Keys, Offset=-1)  # disabled
pshift_9 = ShiftPaths(Data=sort_2.Keys, Offset=-1)  # disabled
mirror_2 = Mirror(Geometry=pt_2, Plane=xz_2)  # -> Geometry, Transform
random_3 = Random(Range=dom_3, Number=Slider(3500, range=0..10000), Seed=Slider(84, range=0..100))

# ---- group: none dup time
int_5 = Integer(pshift_8)  # disabled

# ----
lng_5 = ListLength(List=int_5)  # disabled
panel_6 = Panel(lng_5)  # disabled
panel_7 = Panel(mirror_2.Geometry)

# ---- group: none dup time
int_6 = Integer(pshift_9)  # disabled

# ----
lng_6 = ListLength(List=int_6)  # disabled
panel_8 = Panel(lng_6)  # disabled
item = ListItem(List=int_4, Index=graft(random_3), Wrap=True)
panel_9 = Panel(int_5)  # disabled
number_slider_8 = Slider(1000, range=0..1000)
multiplication_3 = Multiplication(A=panel_5, B=number_slider_8)
multiplication_4 = Multiplication(A=pdecon.YComponent, B=number_slider_8)
multiplication_5 = Multiplication(A=pdecon.ZComponent, B=number_slider_8)
panel_10 = Panel(int_6)  # disabled
pshift_10 = ShiftPaths(Data=item, Offset=-1)
number_slider_9 = Slider(1000, range=0..1000)
int_7 = Integer(multiplication_3)
int_8 = Integer(multiplication_4)
int_9 = Integer(multiplication_5)
division_3 = Division(A=int_7, B=number_slider_8)
division_4 = Division(A=int_8, B=number_slider_8)
sort_3 = SortList(Keys=pshift_10)  # -> Keys, ValuesA
division_5 = Division(A=int_9, B=number_slider_8)
panel_11 = Panel(division_3)

# ---- group: minutes
int_10 = Integer(sort_3.Keys)

# ----
graph = GraphMapper(
    int_3,
    x0=0,
    x1=1440,
    y0=0,
    y1=1,
    container_name="Sine Summation",
    Equation0_px=[0.4998726845, 0],
    Equation0_py=[0.1522498727, 0],
    Equation1_px=[0, 0.2534573674],
    Equation1_py=[0.08167254925, 0.3417996764])
graph_2 = GraphMapper(
    int_10,
    x0=0,
    x1=1440,
    y0=0,
    y1=1,
    container_name="Sine Summation",
    Equation0_px=[0.4998726845, 0],
    Equation0_py=[0.1522498727, 0],
    Equation1_px=[0, 0.2534573674],
    Equation1_py=[0.08167254925, 0.3417996764])
rep = ReplaceText(Text=panel_7, Find=", ", Replace=",", RecursiveReplace=False)
lng_7 = ListLength(List=int_10)
pt_6 = ConstructPoint(XCoordinate=panel_11, YCoordinate=division_4, ZCoordinate=division_5)
rep_2 = ReplaceText(Text=rep, Find="{", RecursiveReplace=False)
random_4 = Random(Range=Domain(0, 1), Number=panel_3, Seed=Slider(0, range=0..100))
random_5 = Random(Range=Domain(0, 1), Number=lng_7, Seed=Slider(35, range=0..100))
pt_7 = Point(pt_6)
panel_12 = Panel(pt_7)
rep_3 = ReplaceText(Text=panel_12, Find=", ", Replace=",", RecursiveReplace=False)
rep_4 = ReplaceText(Text=rep_3, Find="{", RecursiveReplace=False)
rep_5 = ReplaceText(Text=rep_2, Find="}", RecursiveReplace=False)
rep_6 = ReplaceText(Text=rep_4, Find="}", RecursiveReplace=False)
panel_13 = Panel(graph)
panel_14 = Panel(random_4)
panel_15 = Panel(rep_5)
panel_16 = Panel(graph_2)
panel_17 = Panel(random_5)
panel_18 = Panel(rep_6)
smaller = SmallerThan(FirstNumber=panel_14, SecondNumber=panel_13)  # -> SmallerThan, OrEqualTo
smaller_2 = SmallerThan(FirstNumber=panel_17, SecondNumber=panel_16)  # -> SmallerThan, OrEqualTo
cull = CullPattern(List=int_3, CullPattern=smaller.OrEqualTo)
cull_2 = CullPattern(List=int_10, CullPattern=smaller_2.OrEqualTo)
pshift_11 = ShiftPaths(Data=cull, Offset=-1)
pshift_12 = ShiftPaths(Data=cull_2, Offset=-1)
merge = Merge(Data1=pshift_5, Data2=pshift, Data3=panel_15, Data4=pshift_2)
merge_2 = Merge(Data1=pshift_6, Data2=pshift_3, Data3=panel_18, Data4=pshift_4)

# ---- group: time that has requests
int_11 = Integer(pshift_11)

# ----
lng_8 = ListLength(List=int_11)
random_6 = Random(Range=dom_4, Number=lng_8, Seed=Slider(0, range=0..100))
random_7 = Random(Range=dom_4, Number=lng_8, Seed=Slider(1, range=0..1))
int_12 = Integer(random_7)
int_13 = Integer(random_6)
item_2 = ListItem(List=pt_3, Index=int_12, Wrap=True)
item_3 = ListItem(List=pt_3, Index=int_13, Wrap=True)
pshift_13 = ShiftPaths(Data=item_2, Offset=-1)
pshift_14 = ShiftPaths(Data=item_3, Offset=-1)

# ---- group: dropoff pts
pt_8 = Point(pshift_13)

# ---- group: pickup pts
pt_9 = Point(pshift_14)

# ----
pdecon_2 = Deconstruct(Point=pt_8)  # -> XComponent, YComponent, ZComponent
pdecon_3 = Deconstruct(Point=pt_9)  # -> XComponent, YComponent, ZComponent
multiplication_6 = Multiplication(A=pdecon_3.XComponent, B=number_slider_8)
multiplication_7 = Multiplication(A=pdecon_3.YComponent, B=number_slider_8)
multiplication_8 = Multiplication(A=pdecon_2.XComponent, B=number_slider_8)
multiplication_9 = Multiplication(A=pdecon_2.YComponent, B=number_slider_8)
int_14 = Integer(multiplication_6)
int_15 = Integer(multiplication_7)
int_16 = Integer(multiplication_8)
int_17 = Integer(multiplication_9)
division_6 = Division(A=int_14, B=number_slider_8)
division_7 = Division(A=int_15, B=number_slider_8)
division_8 = Division(A=int_16, B=number_slider_8)
division_9 = Division(A=int_17, B=number_slider_8)
panel_19 = Panel(division_9)
panel_20 = Panel(division_8)
panel_21 = Panel(division_7)
panel_22 = Panel(division_6)
merge_3 = Merge(Data1=graft(int_11), Data2=graft(panel_22), Data3=graft(panel_21), Data4=graft(panel_20), Data5=graft(panel_19))
join = TextJoin(Text=merge_3, Join=",")
panel_23 = Panel(lng_8)
pshift_15 = ShiftPaths(Data=join, Offset=-1)

# ---- group: time that has requests
int_18 = Integer(pshift_12)

# ----
lng_9 = ListLength(List=int_18)
random_8 = Random(Range=dom_5, Number=lng_9, Seed=Slider(19, range=0..100))
random_9 = Random(Range=dom_5, Number=lng_9, Seed=Slider(73, range=0..100))
int_19 = Integer(random_9)
int_20 = Integer(random_8)
item_4 = ListItem(List=pt_4, Index=int_19, Wrap=True)
item_5 = ListItem(List=pt_4, Index=int_20, Wrap=True)
pshift_16 = ShiftPaths(Data=item_4, Offset=-1)
pshift_17 = ShiftPaths(Data=item_5, Offset=-1)

# ---- group: dropoff pts
pt_10 = Point(pshift_16)

# ---- group: pickup pts
pt_11 = Point(pshift_17)

# ----
pdecon_4 = Deconstruct(Point=pt_10)  # -> XComponent, YComponent, ZComponent
pdecon_5 = Deconstruct(Point=pt_11)  # -> XComponent, YComponent, ZComponent
multiplication_10 = Multiplication(A=pdecon_5.XComponent, B=number_slider_9)
multiplication_11 = Multiplication(A=pdecon_5.YComponent, B=number_slider_9)
multiplication_12 = Multiplication(A=pdecon_4.XComponent, B=number_slider_9)
multiplication_13 = Multiplication(A=pdecon_4.YComponent, B=number_slider_9)
int_21 = Integer(multiplication_10)
int_22 = Integer(multiplication_11)
int_23 = Integer(multiplication_12)
int_24 = Integer(multiplication_13)
division_10 = Division(A=int_21, B=number_slider_9)
division_11 = Division(A=int_22, B=number_slider_9)
division_12 = Division(A=int_23, B=number_slider_9)
division_13 = Division(A=int_24, B=number_slider_9)
panel_24 = Panel(division_13)
panel_25 = Panel(division_12)
panel_26 = Panel(division_11)
panel_27 = Panel(division_10)
merge_4 = Merge(Data1=graft(int_18), Data2=graft(panel_27), Data3=graft(panel_26), Data4=graft(panel_25), Data5=graft(panel_24))
join_2 = TextJoin(Text=merge_4, Join=",")
panel_28 = Panel(lng_9)
flatten = FlattenTree(Tree=merge, Path="{0}")
flatten_2 = FlattenTree(Tree=merge_2, Path="{0}")
pshift_18 = ShiftPaths(Data=join_2, Offset=-1)
panel_29 = Panel(int_11)
panel_30 = Panel(int_18)
pshift_19 = ShiftPaths(Data=pshift_15, Offset=-1)
pshift_20 = ShiftPaths(Data=pshift_18, Offset=-1)
merge_5 = Merge(Data1=flatten_2, Data2=flatten)
panel_31 = Panel(merge_5)
merge_6 = Merge(Data1="Time,PickupX,PickupY,DropoffX,DropoffY", Data2=pshift_19)
merge_7 = Merge(Data1="Time,PickupX,PickupY,DropoffX,DropoffY", Data2=pshift_20)
panel_32 = Panel(merge_6)
panel_33 = Panel(merge_7)
